# Grasshopper definition Wall Frame.gh (Grasshopper 1.0.7)
# plug-ins: Telepathy, ScriptParasite, gHowl

# ---- group: UDP Recieve
udp = UDPReceiver(Port=Slider(6000, range=0..10000), Pattern=0)  # -> Info, Data
panel = Panel(udp.Data)

# ----
here = MK_Here(OpenDir=Button())  # -> fPath; inputs OpenDir: Boolean
# ---------- here: C# usings ----------
using System.IO;
using System.Diagnostics;
# ---------- here: C# ----------
    GH_Document doc = owner.OnPingDocument();
    string fullPath = doc.FilePath;
    string cleanPath = Path.GetDirectoryName(fullPath);
    string fullName = Path.GetFileName(fullPath);
    string[] fileNames = fullName.Split('.');
    string fileName = fileNames[0];

    string modPath = cleanPath + "/" + fileName;

    if (OpenDir)
    {
      Process.Start(cleanPath);
    }



    fPath = modPath;
# ---------- end here ----------

scriptpar = ScriptParasite(Enable=Toggle(True), Folder=here)
dependency = CSharpScript(refresh=Button(), write=Button(), dir=here)  # -> out, data; inputs write: Boolean, dir: String
# ---------- dependency: C# usings ----------
using System.IO;
# ---------- dependency: C# ----------
    List<string> result = GetAssembly();

    data = result;

    if (write)
    {
      WriteToPath(result, dir, "plugin requirements");
    }
# ---------- dependency: C# additional code ----------
  private List<string> GetAssembly()
  {
    Dictionary<string, string> asms = new Dictionary<string, string>();
    List<string> results = new List<string>();
    foreach (IGH_DocumentObject obj in Grasshopper.Instances.ActiveCanvas.Document.Objects)
    {
      GH_AssemblyInfo asm = Grasshopper.Instances.ComponentServer.FindAssemblyByObject(obj.ComponentGuid);

      if (asm != null && !asm.IsCoreLibrary)
      {
        asms[asm.Name] = asm.Version;
      }
    }

    foreach (KeyValuePair<string, string> pair in asms)
    {
      if (!string.IsNullOrEmpty(pair.Key))
      {
        results.Add(pair.Key + " : " + pair.Value);
      }
    }
    return results;
  }

  private static void WriteToPath(List<string> contents ,string dir, string fileName, string extension = ".txt")
  {
    dir = Path.GetDirectoryName(dir);
    string path = dir + "/" + fileName + extension;
    using (StreamWriter writer = new StreamWriter(path))
    {
      foreach (var content in contents)
      {
        writer.WriteLine(content);
      }
    }
  }
# ---------- end dependency ----------

# ---- group: Window Size
# To add more windows, input additional parameters to winSize and winPos
genes = GenePool(Decimals=3, Maximum=3, Minimum=1, Value=[2.092, 1.676, 2.398])
genes_2 = GenePool(Decimals=3, Maximum=2, Minimum=1, Value=[1.519, 1.198, 1.422])
windowlength = RemoteSender(genes)
windowheight = RemoteSender(genes_2)

# ---- group: Window Position
genes_3 = GenePool(Decimals=3, Maximum=1, Minimum=0, Value=[0.487, 0.087, 0.807])
genes_4 = GenePool(Decimals=3, Maximum=1, Minimum=0, Value=[0.603, 0.467, 0.335])
windowposx = RemoteSender(genes_3)
windowposy = RemoteSender(genes_4)

# ----
panel_2 = Panel(dependency.data)

# ---- group: Wall Inputs
nogging_space = Slider(0.45, range=0..1)
timber_width = Slider(0.045, range=0..1)
timber_height = Slider(0.09, range=0..1)
timber_width_2 = Slider(0.045, range=0..1)
wall_height = Slider(3, range=0..10)
wall_line = Curve(<curve referenced from the Rhino model>)
len = Length(Curve=wall_line)
noggingspace = RemoteSender(nogging_space)
timberheight = RemoteSender(timber_height)
timberwidth = RemoteSender(timber_width)
headerheight = RemoteSender(Slider(0.18, range=0..1))
headerwidth = RemoteSender(timber_width_2)
wallheight = RemoteSender(wall_height)
wallline = RemoteSender(wall_line)
walllength = RemoteSender(len)

# ----
walllength_2 = RemoteReceiver(walllength)  # disabled
wallheight_2 = RemoteReceiver(wallheight)  # disabled
win_size = ConstructPoint(XCoordinate=genes, YCoordinate=genes_2, ZCoordinate=0)  # disabled
wall_size = ConstructPoint(XCoordinate=walllength_2, YCoordinate=wallheight_2, ZCoordinate=0)  # disabled
ratiotolength = CSharpScript(wallSize=wall_size, winSize=win_size)  # -> out, outLength, outHeight; inputs wallSize: Point3d, winSize: Point3d; disabled
# ---------- ratiotolength: C# ----------
    outLength = wallSize.X * winSize.X; // convert window ratio into actual length
    outHeight = wallSize.Y * winSize.Y; // convert window ratio into actual hieght
# ---------- end ratiotolength ----------
noggingspace_2 = RemoteReceiver(noggingspace)
wallline_2 = RemoteReceiver(wallline)
wallheight_3 = RemoteReceiver(wallheight)
windowlength_2 = RemoteReceiver(windowlength)
windowheight_2 = RemoteReceiver(windowheight)
windowposx_2 = RemoteReceiver(windowposx)
windowposy_2 = RemoteReceiver(windowposy)
walllength_3 = RemoteReceiver(walllength)
wallheight_4 = RemoteReceiver(wallheight)

# ---- group: Top Plate
Z = UnitZ(Factor=wallheight_3)
move = Move(Geometry=wallline_2, Motion=Z)  # -> Geometry, Transform

# ----
here_2 = MK_Here(OpenDir=Button())  # -> fPath; inputs OpenDir: Boolean; same code as here
timberwidth_2 = RemoteReceiver(timberwidth)
wall_size_2 = ConstructPoint(XCoordinate=walllength_3, YCoordinate=wallheight_4, ZCoordinate=0)
win_pos = ConstructPoint(XCoordinate=windowposx_2, YCoordinate=windowposy_2, ZCoordinate=0)
win_size_2 = ConstructPoint(XCoordinate=windowlength_2, YCoordinate=windowheight_2, ZCoordinate=0)
stud = Stud(crv=wallline_2, nogspace=noggingspace_2, wall_height=wallheight_3)
wallline_3 = RemoteReceiver(wallline)

scriptpar_2 = ScriptParasite(Enable=Toggle(False), Folder=here_2)
winposlimiter = CSharpScript(wallSize=wall_size_2, winPos=win_pos, winSize=win_size_2)  # -> out, uv; inputs wallSize: Point3d, winPos: Point3d, winSize: Point3d
# ---------- winposlimiter: C# ----------
    Point2d maxPosUv = new Point2d();
    double wallXSize = wallSize.X;
    double wallYSize = wallSize.Y;
    double winXPerPos = winPos.X;
    double winYPerPos = winPos.Y;
    double winXSize = winSize.X;
    double winYSize = winSize.Y;

    double winXPos = winXPerPos * wallXSize;
    double winYPos = winYPerPos * wallYSize;

    double WinXMinPos = winXSize * 0.5;
    double winYMinPos = winYSize * 0.5;

    double winXMaxPos = wallXSize - WinXMinPos;
    double winYMaxPos = wallYSize - winYMinPos;

    // Horizontal limiter (X)
    if (winXPos < WinXMinPos) winXPos = WinXMinPos; // minimum limiter
    else if (winXPos > winXMaxPos) winXPos = winXMaxPos; // maximum limiter


    // Vertical limiter (y)
    if (winYPos < winYMinPos) winYPos = winYMinPos; // minimum limiter
    else if (winYPos > winYMaxPos) winYPos = winYMaxPos; // maximum limiter

    maxPosUv.X = winYPos / wallYSize;
    maxPosUv.Y = winXPos / wallXSize;
    uv = maxPosUv;
# ---------- end winposlimiter ----------

nogging = Nogging(crv=stud, num=timberwidth_2)
extr = Extrude(Base=wallline_3, Direction=Z)
windowheight_3 = RemoteReceiver(windowheight)
windowlength_3 = RemoteReceiver(windowlength)
wall = RemoteSender(extr)
wall_2 = RemoteReceiver(wall)
evalsrf = EvaluateSurface(Surface=reparameterize(wall_2), Point=winposlimiter.uv)  # -> Point, Normal, UDirection, VDirection, Frame
merge = Merge(Data1=wallline_2, Data2=move.Geometry)  # -> flatten(Result)

# ---- group: Window Size Calculate
multiplication = Multiplication(A=windowheight_3, B=0.5)
multiplication_2 = Multiplication(A=windowlength_3, B=0.5)
x = Number(multiplication)
y = Number(multiplication_2)
neg = Negative(Value=x)
neg_2 = Negative(Value=y)
dom = ConstructDomain(DomainStart=neg, DomainEnd=x)
dom_2 = ConstructDomain(DomainStart=neg_2, DomainEnd=y)

# ----
topbottomplate = RemoteSender(merge)
# Window
pt = Point(evalsrf.Point)
windowcenter = RemoteSender(pt)

# ---- group: Window Boundary
rectangle = Rectangle(Plane=evalsrf.Frame, XSize=dom, YSize=dom_2, Radius=0)  # -> Rectangle, Length

# ----
wall_3 = RemoteReceiver(wall)
debrep = DeconstructBrep(Brep=wall_3)  # -> Faces, Edges, Vertices
panel_3 = Panel(rectangle.Rectangle)
here_3 = MK_Here(OpenDir=Button())  # -> fPath; inputs OpenDir: Boolean; same code as here
join = JoinCurves(Curves=debrep.Edges, Preserve=False)
timberwidth_3 = RemoteReceiver(timberwidth)
rec = Rectangle(join)
windowcenter_2 = RemoteReceiver(windowcenter)
multiplication_3 = Multiplication(A=timberwidth_3, B=Slider(2.374, range=1..5))

scriptpar_3 = ScriptParasite(Enable=Toggle(True), Folder=here_3)
windowloclimiter = CSharpScript(wallBound=rec, center=windowcenter_2, rectangle=rectangle.Rectangle, offset=multiplication_3)  # -> out, A; inputs wallBound: Rectangle3d, center: list of Point3d, rectangle: list of Rectangle3d, offset: Double
# ---------- windowloclimiter: C# ----------
    for (int i = 0; i < center.Count; i++)
    {
      // point A
      Point3d ptA = center[i];
      Rectangle3d recA = rectangle[i];
      for (int j = i+1; j < center.Count; j++)
      {
        // point B
        Point3d ptB = center[j];
        Rectangle3d recB = rectangle[j];

        // safe distance
        double winSafeDistanceX = recA.Height*0.5 + recB.Height*0.5 + offset;
        double winDistanceX = Math.Abs(ptA.X - ptB.X);


        if (!(winDistanceX <= winSafeDistanceX)) continue;
        // if distances is less than safe distance

        Point3d wallCenter = wallBound.Center;
        double wallSafeDistanceX;
        double wallDistanceX;
        center.Remove(ptB);
        double difference = winSafeDistanceX - winDistanceX;
        if (ptA.X > ptB.X) // ptB is left
        {
          //ptB.X = ptB.X - difference;
          wallSafeDistanceX = (wallBound.Width * 0.5) - (recB.Height * 0.5);
          wallDistanceX = Math.Abs(wallCenter.X - (ptB.X - difference));
          if (wallDistanceX <= wallSafeDistanceX)
          {
            ptB.X = ptB.X - difference;
          }
          else
          {
            center.Remove(ptA);
            ptA.X = ptA.X + difference;
            center.Insert(i, ptA);
          }
        }
        else // ptB is right
        {
          wallSafeDistanceX = (wallBound.Width * 0.5) - (recB.Height * 0.5);
          wallDistanceX = Math.Abs(wallCenter.X - (ptB.X + difference));
          if (wallDistanceX <= wallSafeDistanceX)
          {
            ptB.X = ptB.X + difference;
          }
          else
          {
            center.Remove(ptA);
            ptA.X = ptA.X - difference;
            center.Insert(i, ptA);
          }
        }
        center.Insert(j,ptB);
      }
    }

    A = center;
# ---------- end windowloclimiter ----------

vec2pt = Vector2Pt(PointA=windowcenter_2, PointB=windowloclimiter.A, Unitize=False)  # -> Vector, Length
windowcenternew = RemoteSender(windowloclimiter.A)
move_2 = Move(Geometry=rectangle.Rectangle, Motion=vec2pt.Vector)  # -> Geometry, Transform
wallline_4 = RemoteReceiver(wallline)
disc = Discontinuity(Curve=move_2.Geometry, Level=1)  # -> Points, Parameters
windowbounds = RemoteSender(move_2.Geometry)
end = EndPoints(Curve=wallline_4)  # -> Start, End
pdecon = Deconstruct(Point=disc.Points)  # -> XComponent, YComponent, ZComponent
pdecon_2 = Deconstruct(Point=end.Start)  # -> XComponent, YComponent, ZComponent
pt_2 = ConstructPoint(XCoordinate=pdecon.XComponent, YCoordinate=pdecon.YComponent, ZCoordinate=pdecon_2.ZComponent)  # -> flatten(Point)
cullpt = CullDuplicates(Points=pt_2, Tolerance=0.1, CullMode=3)  # -> Points, Indices, Valence
crv_cp = CurveClosestPoint(Point=cullpt.Points, Curve=wallline_4)  # -> Point, Parameter, Distance
shatter = Shatter(Curve=wallline_4, Parameters=crv_cp.Parameter)
windowcenternew_2 = RemoteReceiver(windowcenternew)
curvepoint = PointOnCurve(shatter, parameter=0.5)
cp = ClosestPoint(Point=windowcenternew_2, Cloud=curvepoint)  # -> ClosestPoint, CPIndex, Distance
here_4 = MK_Here(OpenDir=Button())  # -> fPath; inputs OpenDir: Boolean; same code as here
noggingspace_3 = RemoteReceiver(noggingspace)
cull_i = CullIndex(List=shatter, Indices=cp.CPIndex, Wrap=True)
timberwidth_4 = RemoteReceiver(timberwidth)
wallheight_5 = RemoteReceiver(wallheight)
concat = Concatenate(FragmentA=here_4, FragmentB="/data.csv")
stud_2 = Stud(crv=cull_i, nogspace=noggingspace_3, wall_height=wallheight_5, timberwidth=timberwidth_4)
windowcenternew_3 = RemoteReceiver(windowcenternew)
panel_4 = Panel(concat)
windowbounds_2 = RemoteReceiver(windowbounds)
noggingspace_4 = RemoteReceiver(noggingspace)
headerheight_2 = RemoteReceiver(headerheight)
timberwidth_5 = RemoteReceiver(timberwidth)
wallheight_6 = RemoteReceiver(wallheight)
item = ListItem(List=shatter, Index=cp.CPIndex, Wrap=False)
w_random_csv = CSharpScript(write=Button(), path=concat, rows=Slider(200, range=0..1000))  # -> out; inputs write: Boolean, path: String, rows: Int32
# ---------- w_random_csv: C# usings ----------
using System.IO;
using System.Text;
# ---------- w_random_csv: C# ----------
    string msg = "";
    if(write)
    {
      WriteToCsv(rows, path);
      msg = "operation completed";
    }
    Print(msg);
# ---------- w_random_csv: C# additional code ----------
  private void WriteToCsv(int rows, string path)
  {
    StringBuilder csvBuilder = new StringBuilder();
    Random random = new System.Random();

    for (int i = 0; i < rows; i++)
    {
      // generate random length between 1 and 6 meter
      double length = (double) random.NextDouble() * 5 + 1;

      // round by 2
      length = (double) System.Math.Round(length, 2);
      int timberNum = i + 1;
      // add to line
      csvBuilder.AppendLine("T" + timberNum + "," + length);
    }
    string[] lines = csvBuilder.ToString().Split(new[] { Environment.NewLine }, StringSplitOptions.None); ;

    // write to file
    File.WriteAllLines(path, lines);
  }
# ---------- end w_random_csv ----------
nogging_2 = Nogging(crv=stud_2, num=timberwidth_4)
window_frame = WindowFrame(
    basecrv=item,
    timberwidth=timberwidth_5,
    nogging_space=noggingspace_4,
    window_center=windowcenternew_3,
    windowboundary=windowbounds_2,
    header_height=headerheight_2,
    wallheight=wallheight_6)  # -> window_reinforcement, cripple, window_sill, window_header
panel_5 = Panel(w_random_csv)
merge_2 = Merge(Data1=stud_2, Data2=nogging_2)  # -> flatten(Result)
r_csv = CSharpScript(refresh=Button(), path=panel_4, delimit=",")  # -> out, values; inputs path: String, delimit: String
# ---------- r_csv: C# ----------
    if (path != null && delimit != null)
    {
      List<string[]> datas = ReadCSV(path, delimit);
      values = ConvertTree(datas);
    }
# ---------- r_csv: C# additional code ----------
  private static List<string[]> ReadCSV(string path, string delimitStr)
  {
    try
    {
      char delimit = char.Parse(delimitStr);
      List<string[]> datas = new List<string[]>();

      using (var reader = new StreamReader(path))
      {
        while (!reader.EndOfStream)
        {
          var line = reader.ReadLine();
          var data = line.Split(delimit);
          if (data[0] != string.Empty)datas.Add(data);
        }
      }

      return datas;
    }
    catch(IOException ex)
    {
      Console.WriteLine("Error reading the file: " + ex.Message);
      return null;
    }
  }

  private static DataTree<string> ConvertTree(List<string[]> datas)
  {
    Grasshopper.DataTree<string> tree = new DataTree<string>();

    for (int i = 0; i < datas.Count; i++)
    {
      string[] data = datas[i];
      foreach (string text in data)
      {
        tree.Add(text, new GH_Path(i));
      }
    }
    return tree;
  }
# ---------- end r_csv ----------

# ---- group: Top & bottom Plate
topbottomplate_2 = RemoteReceiver(topbottomplate)  # disabled
timberheight_2 = RemoteReceiver(timberheight)  # disabled
cap = BooleanToggle(True)  # disabled
timberwidth_6 = RemoteReceiver(timberwidth)  # disabled
crv = Curve(flatten(topbottomplate_2))  # disabled
rec_pipe = RecPipe(crv=graft(crv), x=timberwidth_6, y=timberheight_2, cap=cap)  # disabled
brep = Brep(rec_pipe)  # disabled

# ----
merge_3 = Merge(
    Data1=window_frame.window_reinforcement,
    Data2=window_frame.cripple,
    Data3=window_frame.window_sill,
    Data4=window_frame.window_header,
    Data5=merge_2)

# ---- group: Window Frame
timberheight_3 = RemoteReceiver(timberheight)  # disabled
cap_2 = BooleanToggle(True)  # disabled
timberwidth_7 = RemoteReceiver(timberwidth)  # disabled
crv_2 = Curve(flatten([window_frame.window_reinforcement, window_frame.cripple, window_frame.window_sill]))  # disabled
rec_pipe_2 = RecPipe(crv=graft(crv_2), x=timberwidth_7, y=timberheight_3, cap=cap_2)  # disabled
brep_2 = Brep(rec_pipe_2)  # disabled

# ---- group: Header
flip = BooleanToggle(True)  # disabled
headerheight_3 = RemoteReceiver(headerheight)  # disabled
cap_3 = BooleanToggle(True)  # disabled
headerwidth_2 = RemoteReceiver(headerwidth)  # disabled
crv_3 = Curve(flatten(window_frame.window_header))  # disabled
rec_pipe_3 = RecPipe(crv=graft(crv_3), x=headerwidth_2, y=headerheight_3, cap=cap_3, flip=flip)  # disabled
brep_3 = Brep(rec_pipe_3)  # disabled

# ---- group: Stud
timberheight_4 = RemoteReceiver(timberheight)  # disabled
cap_4 = BooleanToggle(True)  # disabled
timberwidth_8 = RemoteReceiver(timberwidth)  # disabled
crv_4 = Curve(flatten(merge_2))  # disabled
rec_pipe_4 = RecPipe(crv=graft(crv_4), x=timberwidth_8, y=timberheight_4, cap=cap_4)  # disabled
brep_4 = Brep(rec_pipe_4)  # disabled

# ----
here_5 = MK_Here(OpenDir=Button())  # -> fPath; inputs OpenDir: Boolean; same code as here
panel_6 = Panel(r_csv.values)
c_script = CSharpScript(items=r_csv.values)  # -> out, strs; inputs items: tree of String
# ---------- c_script: C# ----------
    List<string> strings = new List<string>();
    for (int i = 0;i < items.BranchCount;i++)
    {
      List<string> item = items.Branch(i);
      string str = item[0] + "::" + item[1];
      strings.Add(str);
    }
    strs = strings;
# ---------- end c_script ----------

scriptpar_4 = ScriptParasite(Enable=Toggle(True), Folder=here_5)
compare = CSharpScript(salvageData=c_script.strs, frameT=merge_3, tolerance=Slider(0.03, range=0..0.1), EnableDoubleMatch=Toggle(True))  # -> out, pairDatas; inputs salvageData: list of String, frameT: list of Double, tolerance: Double, EnableDoubleMatch: Boolean
# ---------- compare: C# usings ----------
using System.Linq;
using System.Reflection.Emit;
using System.Threading.Tasks;
using System.Xml.Linq;
using Rhino.FileIO;
# ---------- compare: C# ----------
    // (frameLength)(<salvageName1, salvageLength1><...>)

    pairDatas = FindCombinationBinary(frameT, salvageData, tolerance, EnableDoubleMatch);
# ---------- compare: C# additional code ----------
  private List<string> FindCombination(List<double> targetLengths, List<string>salData, double tolerance, bool doubleMatch)
  {
    List<string> matchedList = new List<string>();

    List<string> serializedData = new List<string>();

    // iterate through target frames
    for (int z = 0; z < targetLengths.Count; z++)
    {
      var targetLength = targetLengths[z];
      targetLength = Math.Round(targetLength, 2);
      var targetName = "Tar" + z;

      // iterate through first salvage timber
      for (int i = 0; i < salData.Count; i++)
      {
        string salAData = salData[i];
        string[] salADataSplit = salAData.Split(new string[] { "::" }, StringSplitOptions.None);
        string salAName = salADataSplit[0];
        double salAValue = double.Parse(salADataSplit[1]);

        // solo pair condition
        bool inMatchListA = matchedList.Contains(salAName);
        bool matchedSolo = MatchSolo(salAValue, targetLength, tolerance);


        //if (matchedSolo && !inMatchListA && !doubleMatch)
        if (matchedSolo && !inMatchListA)
        {
          matchedList.Add(salAName);

          string dataSolo = Serializer(targetName, targetLength, salAName, salAValue);
          dataSolo = "{MinCut}" + dataSolo;
          serializedData.Add(dataSolo);

          // break compare loop
          break;
        }

        // double match (heavy)
        if (!doubleMatch) continue;

        // iterate through second salvage timber
        for (int j = i + 1; j < salData.Count; j++)
        {
          string salBData = salData[j];
          string[] salBDataSplit = salBData.Split(new string[] { "::" }, StringSplitOptions.None);
          string salBName = salBDataSplit[0];
          double salBValue = double.Parse(salBDataSplit[1]);

          // conditions
          bool matched = MatchDouble(salAValue, salBValue, targetLength, tolerance);
          bool inMatchListB = matchedList.Contains(salBName);

          // if match
          if (!matched || inMatchListA || inMatchListB) continue;
          matchedList.Add(salAName);
          matchedList.Add(salBName);

          string dataDouble = Serializer(targetName, targetLength, salAName, salAValue, salBName, salBValue);
          dataDouble = "{MinCut}" + dataDouble;
          serializedData.Add(dataDouble);
          // break compare loop
          goto CompareExit;
        }

      }
      // exit compare loop
      CompareExit:
        ;
    }

    return serializedData;
  }

  private List<string> FindCombinationParallel(List<double> targetLengths, List<string> salData, double tolerance, bool doubleMatch)
  {

    List<string> matchedSal = new List<string>();
    List<string> matchedTarget = new List<string>();

    List<string> serializedData = new List<string>();
    
    // iterate through target frames
    for(int z=0; z<targetLengths.Count; z++)
    {
      var targetLength = targetLengths[z];
      targetLength = Math.Round(targetLength, 2);
      var targetName = "Tar" + z;

      bool breakInner = false;

      Parallel.For(0, salData.Count, (i, stateI) =>
      {
        if (breakInner)
        {
          stateI.Break();
        }

        string salAData = salData[i];
        string salAName;
        double salAValue;
        DeSerializer(salAData, out salAValue, out salAName);


        // solo pair condition
        bool inMatchListA = matchedSal.Contains(salAName);
        bool inMatchTarget = matchedTarget.Contains(targetName);
        bool matchedSolo = MatchSolo(salAValue, targetLength, tolerance);


        //if (matchedSolo && !inMatchListA && !doubleMatch)
        if (matchedSolo && !inMatchListA && !inMatchTarget)
        { 
          matchedSal.Add(salAName);
          matchedTarget.Add(targetName);

          string dataSolo = Serializer(targetName, targetLength, salAName, salAValue);
          dataSolo = "{MinCut}" + dataSolo;
          serializedData.Add(dataSolo);

          // break compare loop
          stateI.Break();
        }

        // double match (heavy) ** if not (double Match) continue
        if (!doubleMatch) return;

        Parallel.For(i + 1, salData.Count, (j, stateJ) =>
        {
          string salBData = salData[j];
          string salBName;
          double salBValue;
          DeSerializer(salBData, out salBValue, out salBName);


          // conditions
          bool matched = MatchDouble(salAValue, salBValue, targetLength, tolerance);
          bool inMatchListB = matchedSal.Contains(salBName);

          // if match
          if (!matched || inMatchListA || inMatchListB || inMatchTarget) return;
          matchedSal.Add(salAName);
          matchedSal.Add(salBName);

          string dataDouble = Serializer(targetName, targetLength, salAName, salAValue, salBName, salBValue);
          dataDouble = "{MinCut}" + dataDouble;
          serializedData.Add(dataDouble);

          // break compare loop
          breakInner = true;
          stateJ.Break();
        });

      });

    }

    return serializedData;
  }

  private List<string> FindCombinationBinary(List<double> targetLengths, List<string> salData, double tolerance, bool doubleMatch)
  {
    List<string> matchedList = new List<string>();

    List<string> serializedData = new List<string>();

    Dictionary<string, double> targetDict = DeSerializer(targetLengths);
    Dictionary<string, double> salvageDict = DeSerializer(salData);

    Dictionary<string, double> singleRemainTargets = new Dictionary<string, double>();
    Dictionary<string, double> singleRemainSal = new Dictionary<string, double>();

    Dictionary<string, double> doubleRemainTargets = new Dictionary<string, double>();
    Dictionary<string, double> doubleRemainSal = new Dictionary<string, double>();

    // single matching
    Dictionary<string, string> singleMatchedDict = SingleMatch(
      targetDict,
      salvageDict,
      tolerance,
      out singleRemainTargets,
      out singleRemainSal);

    // serialization of data
    foreach (var match in singleMatchedDict)
    {
      string dataStr = Serializer(match.Key, targetDict[match.Key], match.Value, salvageDict[match.Value]);
      double offcuts = CalculateOffcuts(targetDict[match.Key], salvageDict[match.Value]);
      dataStr = "|" + offcuts + "|" + "{minCut}" + dataStr;
      serializedData.Add(dataStr);
    }


    // double matching
    if (!doubleMatch) return serializedData;
    {
      Dictionary<string, Tuple<string, string>> doubleMatchedDict = DoubleMatch(
        singleRemainTargets,
        singleRemainSal,
        tolerance,
        out doubleRemainTargets,
        out doubleRemainSal);

      // serialization of data
      foreach (var match in doubleMatchedDict)
      {
        string targetName = match.Key;
        double targetVal = targetDict[targetName];

        string salAName = match.Value.Item1;
        double salAVal = salvageDict[salAName];

        string salBName = match.Value.Item2;
        double salBVal = salvageDict[salBName];

        string dataStr = Serializer(targetName, targetVal, salAName, salAVal, salBName, salBVal);
        double offcuts = CalculateOffcuts(targetVal, salAVal + salBVal);
        dataStr = "|" + offcuts + "|" + "{minCut}" + dataStr;

        serializedData.Add(dataStr);
      }
    }

    Dictionary<string, Tuple<string, double, bool>> restComb = FindRestComb(doubleRemainTargets, doubleRemainSal, tolerance);
    foreach (var match in restComb)
    {
      double originalSalLength = salvageDict[match.Value.Item1];
      double cutLength = match.Value.Item2 - originalSalLength;
      string dataStr = Serializer(match.Key, targetDict[match.Key], match.Value.Item1, match.Value.Item2, match.Value.Item3, cutLength);
      double offcuts = CalculateOffcuts(targetDict[match.Key], match.Value.Item2);
      dataStr = "|" + offcuts + "|" + "{elseCut}" + dataStr;
      serializedData.Add(dataStr);
    }

    return serializedData;
  }

  private static string Serializer(string tarName, double tarLen, string salName, double salLen, bool isCut, double cutLength)
  {
    if (isCut)
    {
      string target = "(" + tarName + "," + tarLen + ")";
      string salvage = "<" + salName + "," + salLen + ">";
      string cut = "[" + Math.Round(cutLength, 2) + "]";
      return target + salvage + cut;
    }
    else
    {
      string target = "(" + tarName + "," + tarLen + ")";
      string salvage = "<" + salName + "," + salLen + ">";
      return target + salvage;
    }
  }

  private static double CalculateOffcuts(double target, double salvage)
  {
    double offcuts = salvage - target;
    return Math.Round(offcuts, 2);
  }

  private static Dictionary<string, Tuple<string, double, bool>> FindRestComb(Dictionary<string, double> targets, Dictionary<string, double> salvages, double tolerance)
  {
    // (targetName, <SalvageName, lengthLeft, isCut>)
    Dictionary<string, Tuple<string, double, bool>> resultsDictionary = new Dictionary<string, Tuple<string, double, bool>>();

    Dictionary<string, Tuple<string, double>> foundPairsDict = new Dictionary<string, Tuple<string, double>>();
    

    List<string> matchList = new List<string>();

    // single matching
    foreach (var target in targets)
    {
      double targetValue = target.Value;
      string targetName = target.Key;

      Dictionary<string, double> pairs = new Dictionary<string, double>();
      
      foreach (var salvage in salvages)
      {
        double difference = salvage.Value - targetValue;
        if (difference < 0) continue;
        pairs.Add(salvage.Key, difference);
      }

      var sortedPairs = pairs.OrderBy(pair => pair.Value).ToDictionary(x => x.Key, x => x.Value);

      int elementIdx = 0;
      while (elementIdx < sortedPairs.Count && matchList.Contains(sortedPairs.ElementAt(elementIdx).Key))
      {
        elementIdx++;
      }
      var smallestPair = sortedPairs.ElementAt(elementIdx);

      matchList.Add(smallestPair.Key);
      foundPairsDict.Add(targetName, Tuple.Create(smallestPair.Key, smallestPair.Value));
    }


    foreach (var pair in foundPairsDict)
    {
      string targetName = pair.Key;
      double targetLength = targets[pair.Key];
      string salvageName = pair.Value.Item1;
      double salvageLength = pair.Value.Item2;
      double difference = targetLength - salvageLength;
      if (difference >= 0.3)
      {
        double cutLength = difference;
        salvageLength = targetLength;
        foreach (var newTarget in targets)
        {
          bool matched = MatchSolo(cutLength, newTarget.Value, tolerance);
          if (matched)
          {
            // Check if the key already exists in the dictionary before adding it
            if (resultsDictionary.ContainsKey(targetName)) continue;
            resultsDictionary.Add(targetName, Tuple.Create(salvageName, salvageLength, true));
            if (resultsDictionary.ContainsKey(newTarget.Key)) continue;
            resultsDictionary.Add(newTarget.Key, Tuple.Create(salvageName, cutLength, true));
            break;
          }
        }
      }

      else
      {
        // Check if the key already exists in the dictionary before adding it
        if (resultsDictionary.ContainsKey(targetName)) continue;
        resultsDictionary.Add(targetName, Tuple.Create(salvageName, salvageLength, false));
      }
    }

    return resultsDictionary;
  }



  private static Dictionary<string, Tuple<string, string>> DoubleMatch(Dictionary<string, double> targets, Dictionary<string, double> salvages, double tolerance,
    out Dictionary<string, double> remainTargets, out Dictionary<string, double> remainSalvages)
  {
    Dictionary<string, Tuple<string, string>> matchedID = new Dictionary<string, Tuple<string, string>>();

    remainSalvages = salvages.ToDictionary(salvage => salvage.Key, salvage => salvage.Value);
    remainTargets = targets.ToDictionary(target => target.Key, target => target.Value);


    List<string> matchList = new List<string>();
    List<double> sortedSalvageValues = salvages.Values.ToList();
    sortedSalvageValues.Sort();

    foreach (var target in targets)
    {
      // simultaneously working with 2 index by starting timberA on 0 and timber B on last index
      // binary search algorithm
      int timberLeftIdx = 0;
      int timberRightIdx = sortedSalvageValues.Count - 1;

      while (timberLeftIdx < timberRightIdx)
      {
        double sum = sortedSalvageValues[timberLeftIdx] + sortedSalvageValues[timberRightIdx];

        // if sum of two timber is within tolerance of target value
        if (Math.Abs(sum - target.Value) <= tolerance)
        {
          string leftKey = salvages.FirstOrDefault(x => x.Value == sortedSalvageValues[timberLeftIdx]).Key;
          string rightKey = salvages.FirstOrDefault(x => x.Value == sortedSalvageValues[timberRightIdx]).Key;

          // skip if left or right key is contained in matchList
          if (matchList.Contains(leftKey) || matchList.Contains(rightKey))
          {
            timberLeftIdx++;
            continue;
          }
          // found match

          matchList.Add(leftKey);
          matchList.Add(rightKey);

          remainTargets.Remove(target.Key);
          remainSalvages.Remove(leftKey);
          remainSalvages.Remove(rightKey);

          Tuple<string, string> pairs = Tuple.Create(leftKey, rightKey);
          matchedID.Add(target.Key, pairs);
          break;
        }
        else if (sum < target.Value)
        {
          timberLeftIdx++;
        }
        else
        {
          timberRightIdx--;
        }
      }
    }

    return matchedID;
  }


  private static Dictionary<string, string> SingleMatch(Dictionary<string, double> targets, Dictionary<string, double> salvages, double tolerance, out Dictionary<string, double> remainTargets, out Dictionary<string, double> remainSal)
  {
    remainTargets = new Dictionary<string, double>();
    remainSal = new Dictionary<string, double>();

    foreach (var target in targets)
    {
      remainTargets.Add(target.Key, target.Value);
    }

    foreach (var salvage in salvages)
    {
      remainSal.Add(salvage.Key, salvage.Value);
    }


    Dictionary<string, string> matchedID = new Dictionary<string, string>();

    foreach (var target in targets)
    {
      foreach (var salvage in salvages)
      {
        bool matched = MatchSolo(salvage.Value, target.Value, tolerance);

        if (!matched || matchedID.Values.Contains(salvage.Key)) continue;
        remainTargets.Remove(target.Key);
        remainSal.Remove(salvage.Key);

        matchedID.Add(target.Key, salvage.Key);
        break;
      }
    }

    return matchedID;
  }

  private static Dictionary<string, double> DeSerializer(List<double> data)
  {
    Dictionary<string, double> deSerializedData = new Dictionary<string, double>();
    for (int i = 0; i < data.Count; i++)
    {
      double value = Math.Round(data[i], 2);
      string name = "Tar" + i.ToString();

      deSerializedData.Add(name, value);
    }
    return deSerializedData;
  }

  private static Dictionary<string, double> DeSerializer(List<string> data)
  {
    Dictionary<string, double> deSerializedData = new Dictionary<string, double>();
    foreach (var d in data)
    {
      string[] salADataSplit = d.Split(new string[] { "::" }, StringSplitOptions.None);
      string Name = salADataSplit[0];
      double value = double.Parse(salADataSplit[1]);


      deSerializedData.Add(Name, value);
    }

    return deSerializedData;
  }

  private static void DeSerializer(string data, out double value, out string Name)
  {
    string[] salADataSplit = data.Split(new string[] { "::" }, StringSplitOptions.None);
    Name = salADataSplit[0];
    value = double.Parse(salADataSplit[1]);
  }

  private static bool MatchSolo(double salvage, double target, double tolerance)
  {
    double difference = salvage - target;

    if (difference < 0)
    {
      return false;
    }
    else
    {
      return difference <= tolerance;
    }
  }

  private static bool MatchDouble(double a, double b, double target, double tolerance)
  {
    double sum = a + b;
    double difference = sum - target;

    if (difference < 0)
    {
      return false;
    }
    else
    {
      return difference < tolerance;
    }
  }

  private static string Serializer(string tarName, double tarLen, string salAName, double salAVal)
  {
    string targetStr = "(" + tarName + "," + tarLen + ")";
    string salA = "<" + salAName + "," + salAVal + ">";
    string serialized = targetStr + salA;
    return serialized;
  }

  private static string Serializer(string tarName, double tarLen, string salAName, double salAVal, string salBName, double salBVal)
  {
    string targetStr = "(" + tarName + "," + tarLen + ")";
    string salA = "<" + salAName + "," + salAVal + ">";
    string salB = "<" + salBName + "," + salBVal + ">";
    string serialized = targetStr + salA + salB;
    return serialized;
  }
# ---------- end compare ----------

here_6 = MK_Here(OpenDir=Button())  # -> fPath; inputs OpenDir: Boolean; same code as here
panel_7 = Panel(compare.out)
lng = ListLength(List=c_script.strs)

scriptpar_5 = ScriptParasite(Enable=Toggle(True), Folder=here_6)
evaluation = CSharpScript(datas=compare.pairDatas, SalvageTimberTotal=lng)  # -> out, flatten(score); inputs datas: list of String, SalvageTimberTotal: Int32
# ---------- evaluation: C# usings ----------
using System.CodeDom;
using System.Linq;
# ---------- evaluation: C# ----------
    List<double> timberALs = new List<double>();
    List<double> timberBLs = new List<double>();
    List<double> timberBLs_Clean = new List<double>();
    List<double> offcuts = new List<double>();
    DeSerialize(datas, out timberALs, out timberBLs, out offcuts);

    // count all salvage timber that were used
    int salvageTimberUsedCount = timberALs.Count;
    foreach (double timberB in timberBLs)
    {
      if (!double.IsNaN(timberB))
      {
        salvageTimberUsedCount ++;
        timberBLs_Clean.Add(timberB);
      }
    }
    // total offcuts calculation
    double totalOffcuts = offcuts.Sum();

    // total salvage timber length
    double totalSalvageLength = timberALs.Sum() + timberBLs_Clean.Sum();

    // length usage efficiency
    double materialEfficiency = totalOffcuts/ totalSalvageLength ;
    materialEfficiency = (1.0 / materialEfficiency) * 10;

    // labor efficiency
    int offcutsCount = CountOffcuts(offcuts);
    double laborEfficiency = (double)datas.Count/ (double)offcutsCount * 10;


    double calculation = (laborEfficiency / 2.0) + (materialEfficiency / 2.0);


    score = Math.Round(calculation, 5).ToString();
# ---------- evaluation: C# additional code ----------
  private void DeSerialize(List<string> datas, out List<double> timberALs, out List<double> timberBLs, out List<double> offcuts)
  {
    timberALs = new List<double>();
    timberBLs = new List<double>();
    offcuts = new List<double>();
    foreach (var data in datas)
    {
      string[] offcutsData = data.Split(new string[]{"|", "|"}, StringSplitOptions.RemoveEmptyEntries);
      double offcut = double.Parse(offcutsData[0]);
      offcuts.Add(offcut);


      string[] values = data.Split(new string[]{"<", ">"}, StringSplitOptions.RemoveEmptyEntries);
      double timberA = double.Parse(values[1].Split(',')[1]);
      double timberB = Double.NaN;
      if (values.Length == 3)
      {
        timberB = double.Parse(values[2].Split(',')[1]);
      }
      timberALs.Add(timberA);
      timberBLs.Add(timberB);
    }
  }

  private int CountOffcuts(List<double> offcuts)
  {
    int count = 0;
    foreach (var cut in offcuts)
    {
      if (cut != 0)
      {
        count++;
      }
    }
    return count;
  }
# ---------- end evaluation ----------

concstr = CSharpScript()  # -> outStr; inputs lsStr: list of String
# ---------- concstr: C# ----------
    string concStr = "";
    foreach (string str in lsStr)
    {
      if (concStr != "")
      {
        concStr = concStr + "|" + str;
      }
      else
      {
        concStr = concStr + str;
      }

    }
    outStr = concStr;
# ---------- end concstr ----------
getbytes = CSharpScript(data=evaluation.score)  # -> bytes, byteSize; inputs data: String
# ---------- getbytes: C# ----------
    byte[] dataBytes = System.Text.Encoding.UTF8.GetBytes(data);
    bytes = dataBytes;
    byteSize = "Data Size: " + dataBytes.Length + " byte";
# ---------- end getbytes ----------
# ** Performance Optimization
# *Total Offcut
# *fit for all frame - priority is salvage timber
# * cut number count
# * offcut reuse > 300mm
# ** salvage T must bigger
# * Salvage timber highlight?
panel_8 = Panel(compare.pairDatas)
score = Panel(evaluation.score)
panel_9 = Panel(getbytes.byteSize)

# ---- group: UDP Send
udp_2 = UDPSender(Port=Slider(6001, range=0..10000), Pattern=0, Data="dddddd")
panel_10 = Panel(udp_2)

# ==== cluster RecPipe
y = ClusterInput()
cap = ClusterInput()
flip = ClusterInput()  # Flip timber horizontally
x = ClusterInput()
y_2 = Number(y)
x_2 = Number(x)
bool = Boolean(cap)
bool_2 = Boolean(flip)
c_script = CSharpScript(x=x_2, y=y_2, Pattern=bool_2)  # -> out, outX, outY; inputs x: Double, y: Double, Pattern: Boolean
# ---------- c_script: C# ----------
    if (Pattern == true)
    {
      outX = y;
      outY = x;
    }
    else
    {
      outX = x;
      outY = y;
    }
# ---------- end c_script ----------
crv = ClusterInput()
crv_2 = Curve(crv)
multiplication = Multiplication(A=c_script.outX, B="0.5")
multiplication_2 = Multiplication(A=c_script.outY, B="0.5")

# ---- group: Rec Y
neg = Negative(Value=multiplication_2)
dom = ConstructDomain(DomainStart=neg, DomainEnd=multiplication_2)

# ---- group: Rec X
neg_2 = Negative(Value=multiplication)
dom_2 = ConstructDomain(DomainStart=neg_2, DomainEnd=multiplication)

# ---- group: Rectangular pofile
pframe = PerpFrame(Curve=reparameterize(crv_2), Parameter="1")
pframe_2 = PerpFrame(Curve=reparameterize(crv_2), Parameter="0")
rectangle = Rectangle(Plane=pframe, XSize=dom_2, YSize=dom, Radius=0)  # -> Rectangle, Length
rectangle_2 = Rectangle(Plane=pframe_2, XSize=dom_2, YSize=dom, Radius=0)  # -> Rectangle, Length

# ---- group: Cap
boundary = BoundarySurfaces(Edges=[rectangle.Rectangle, rectangle_2.Rectangle])

# ---- group: Body
swp1 = Sweep1(Rail=crv_2, Sections=rectangle_2.Rectangle, Miter=1)

# ---- group: If Cap
if = CullPattern(List=[swp1, boundary], CullPattern=bool)  # -> flatten(List)

# ---- group: otherwise
else = CullPattern(List=swp1, CullPattern=invert(bool))

# ----
join = BrepJoin(Breps=flatten([else, if]))  # -> Breps, Closed
B = ClusterOutput(join.Breps)

# ==== cluster Nogging
crv = ClusterInput()
num = ClusterInput()
crv_2 = Curve(crv)
curvepoint = PointOnCurve(crv_2, parameter=0.5)
shift = ShiftList(List=curvepoint, Shift=1, Wrap=False)
c_script = CSharpScript(ptA=curvepoint, ptB=shift, TW=num)  # -> out, A, B; inputs ptA: Point3d, ptB: Point3d, TW: Double
# ---------- c_script: C# ----------
    double moveAmount = TW * 0.5;
    ptA.X = ptA.X + moveAmount;
    ptB.X = ptB.X - moveAmount;
    
    A = ptA;
    B = ptB;
# ---------- end c_script ----------
num_2 = Number(num)
ln = Line(StartPoint=c_script.A, EndPoint=c_script.B)
relast = RemoveLastItem(List=ln, NumberOfItems=1)
python = GhPythonScript(L=relast)  # -> L1, L2; inputs L: list of Line
# ---------- python: Python ----------
import rhinoscriptsyntax as rs

list1 = []
list2 = []

for idx, item in enumerate(L):
    if (idx % 2) == 0:
        # index is even number
        list2.append(item)
    else:
        # index is odd number
        list1.append(item)
L1 = list1
L2 = list2
# ---------- end python ----------
neg = Negative(Value=num_2)
Z = UnitZ(Factor=num_2)
Z_2 = UnitZ(Factor=neg)
move = Move(Geometry=python.L1, Motion=Z)  # -> Geometry, Transform
move_2 = Move(Geometry=python.L2, Motion=Z_2)  # -> Geometry, Transform
cullnull = CullNull(relay=move.Geometry)
cullnull_2 = CullNull(relay=move_2.Geometry)
crv_3 = Curve(flatten([cullnull, cullnull_2]))
crv_4 = ClusterOutput(crv_3)

# ==== cluster Stud
crv = ClusterInput()  # Input Curve for wall base line
nogspace = ClusterInput()  # Nogging Space Distance
wall_height = ClusterInput()  # Wall height
timberwidth = ClusterInput()  # Timber Width
len = Length(Curve=crv)
division = Division(A=len, B=nogspace)
round = Round(Number=division)  # -> Nearest, Floor, Ceiling
Z = UnitZ(Factor=wall_height)
divide = DivideCurve(Curve=crv, Count=round.Ceiling, Kinks=False)  # -> Points, Tangents, Parameters
move = Move(Geometry=divide.Points, Motion=Z)  # -> Geometry, Transform
c_script = CSharpScript(ptA=divide.Points, ptB=move.Geometry, TW=timberwidth)  # -> out, A, B; inputs ptA: Point3d, ptB: Point3d, TW: Double
# ---------- c_script: C# ----------
    double moveAmount = TW * 0.5;
    ptA.Z = ptA.Z + moveAmount;
    ptB.Z = ptB.Z - moveAmount;
    A = ptA;
    B = ptB;
# ---------- end c_script ----------
ln = Line(StartPoint=c_script.A, EndPoint=c_script.B)
L = ClusterOutput(ln)

# ==== cluster WindowFrame
basecrv = ClusterInput()  # Base curve for wall
timberwidth = ClusterInput()  # Stud Timber Width
nogging_space = ClusterInput()  # Nogging Spacing
window_center = ClusterInput()  # Window center point
windowboundary = ClusterInput()  # Window boundary frame (rectangle)
header_height = ClusterInput()  # Header height dimension
wallheight = ClusterInput()  # Wall height
crv = Curve(basecrv)
c_script = CSharpScript(Rec=windowboundary)  # -> Height, Width; inputs Rec: Rectangle3d
# ---------- c_script: C# ----------
    Height = Rec.Height;
    Width = Rec.Width;
# ---------- end c_script ----------
pdecon = Deconstruct(Point=window_center)  # -> XComponent, YComponent, ZComponent
headerheight = Number(header_height)
len = Length(Curve=crv)
multiplication = Multiplication(A=c_script.Width, B="0.5")
division = Division(A=len, B=nogging_space)
addition = Addition(A=pdecon.ZComponent, B=multiplication)
subtraction = Subtraction(A=pdecon.ZComponent, B=multiplication)
round = Round(Number=division)  # -> Nearest, Floor, Ceiling
# Space for header
header_height_2 = Number(simplify(graft(addition)))
sill_height = Number(simplify(graft(subtraction)))
divide = DivideCurve(Curve=crv, Count=round.Ceiling, Kinks=False)  # -> simplify(Points), Tangents, Parameters
Z = UnitZ(Factor=sill_height)
move = Move(Geometry=divide.Points, Motion=Z)  # -> Geometry, Transform
timberwidth_2 = Number(timberwidth)
first_last = MK_FirstLast(L=move.Geometry)  # -> first, mid, last; inputs L: list, n: Int32
# ---------- first_last: Python ----------
if not L:
    L = [0]
if not n:
    n = 0
mid = L[1+n:-1-n]

first = L[0+n]
last = L[-1-n]
# ---------- end first_last ----------
first_last_2 = MK_FirstLast(L=divide.Points)  # -> first, mid, last; inputs L: list, n: Int32; same code as first_last
multiplication_2 = Multiplication(A=headerheight, B="0.5")
Z_2 = UnitZ(Factor=header_height_2)
move_2 = Move(Geometry=divide.Points, Motion=Z_2)  # -> Geometry, Transform
neg = Negative(Value=headerheight)
first_last_3 = MK_FirstLast(L=move_2.Geometry)  # -> first, mid, last; inputs L: list, n: Int32; same code as first_last
neg_2 = Negative(Value=multiplication_2)
Z_3 = UnitZ(Factor=neg)
Z_4 = UnitZ(Factor=neg_2)
c_script_2 = CSharpScript(ptB=first_last_2.first, TW=timberwidth_2)  # -> out, B; inputs ptB: Point3d, TW: Double
# ---------- c_script_2: C# ----------
    double moveAmount = TW * 0.5;
    ptB.Z = ptB.Z + moveAmount;

    B = ptB;
# ---------- end c_script_2 ----------
c_script_3 = CSharpScript(ptA=first_last.first, ptB=first_last.last, timberWidth=timberwidth_2)  # -> out, A, B; inputs ptA: Point3d, ptB: Point3d, timberWidth: Double
# ---------- c_script_3: C# ----------
    double moveAmount = (timberWidth * 0.5) * 3;
    ptA.X = ptA.X + moveAmount;
    ptB.X = ptB.X - moveAmount;
    A = ptA;
    B = ptB;
# ---------- end c_script_3 ----------
move_3 = Move(Geometry=first_last_3.first, Motion=Z_3)  # -> Geometry, Transform
neg_3 = Negative(Value=headerheight)
pdecon_2 = Deconstruct(Point=first_last_3.mid)  # -> XComponent, YComponent, ZComponent
multiplication_3 = Multiplication(A=timberwidth_2, B="0.5")
c_script_4 = CSharpScript(ptB=first_last_2.mid, TW=timberwidth_2)  # -> out, B; inputs ptB: Point3d, TW: Double; same code as c_script_2
move_4 = Move(Geometry=first_last_3.first, Motion=Z_4)  # -> Geometry, Transform
move_5 = Move(Geometry=first_last_3.last, Motion=Z_4)  # -> Geometry, Transform
Z_5 = UnitZ(Factor=neg_3)

# ---- group: Left
ln = Line(StartPoint=c_script_2.B, EndPoint=move_3.Geometry)
vec = VectorXYZ(XComponent=timberwidth_2, YComponent=0, ZComponent=0)  # -> Vector, Length
move_6 = Move(Geometry=ln, Motion=vec.Vector)  # -> Geometry, Transform

# ----
pt = ConstructPoint(XCoordinate=pdecon_2.XComponent, YCoordinate=pdecon_2.YComponent, ZCoordinate=wallheight)
Z_6 = UnitZ(Factor=multiplication_3)
move_7 = Move(Geometry=first_last_3.last, Motion=Z_5)  # -> Geometry, Transform
ln_2 = Line(StartPoint=c_script_3.A, EndPoint=c_script_3.B)
c_script_5 = CSharpScript(ptB=first_last_2.last, TW=timberwidth_2)  # -> out, B; inputs ptB: Point3d, TW: Double; same code as c_script_2
ln_3 = Line(StartPoint=c_script_4.B, EndPoint=first_last.mid)
c_script_6 = CSharpScript(ptB=pt, TW=timberwidth_2)  # -> out, B; inputs ptB: Point3d, TW: Double
# ---------- c_script_6: C# ----------
    double moveAmount = TW * 0.5;
    ptB.Z = ptB.Z - moveAmount;

    B = ptB;
# ---------- end c_script_6 ----------
c_script_7 = CSharpScript(ptA=move_4.Geometry, ptB=move_5.Geometry, TW=timberwidth_2)  # -> out, A, B; inputs ptA: Point3d, ptB: Point3d, TW: Double; same code as c_script
move_8 = Move(Geometry=ln_2, Motion=Z_6)  # -> Geometry, Transform

# ---- group: Right
ln_4 = Line(StartPoint=c_script_5.B, EndPoint=move_7.Geometry)
neg_4 = Negative(Value=timberwidth_2)
vec_2 = VectorXYZ(XComponent=neg_4, YComponent=0, ZComponent=0)  # -> Vector, Length
move_9 = Move(Geometry=ln_4, Motion=vec_2.Vector)  # -> Geometry, Transform

# ----
ln_5 = Line(StartPoint=first_last_3.mid, EndPoint=c_script_6.B)
sill = Curve(flatten(move_8.Geometry))

# ---- group: Cripple
merge = Merge(Data1=ln_3, Data2=ln_5)  # -> flatten(Result)

# ---- group: Header
ln_6 = Line(StartPoint=c_script_7.A, EndPoint=c_script_7.B)  # -> flatten(Line)

# ---- group: Window Reinforcement
merge_2 = Merge(Data1=move_6.Geometry, Data2=move_9.Geometry)  # -> flatten(Result)

# ----
cripple = ClusterOutput(merge)  # Cripple
window_sill = ClusterOutput(sill)  # Window Sill
window_reinforcement = ClusterOutput(merge_2)  # Window Reinforcement
header = Curve(flatten(ln_6))
window_header = ClusterOutput(header)  # Window Header

# ==== cluster CullNull
relay = ClusterInput()
null = NullItem(Item=relay)  # -> NullFlags, InvalidFlags, Description
cull = CullPattern(List=relay, CullPattern=invert(null.NullFlags))
L = ClusterOutput(cull)
